# Dynamo graph 3point_script.dyn (Dynamo 2.6.1.8786)
# packages: Ampersand 2019.12.31, Data-Shapes 2021.2.94

# note: DYNAMO VERSION
# 2.6.1
# PACKAGE(S) / VERSION
# Data-Shapes 2021.2.94
# Ampersand / 2019.12.31
# ASSOCIATED FILE(S)
# 3-point Adaptive Family
# AUTHOR(S) / DATE
# Pete Heibel / July 2021
# DESCRIPTION
# Array a 3-point adaptive family across the selected surface.
# Adjust the 'U Grid' and 'V Grid' sliders to adjust the number of rows and columns.
# Adjust the 'Minimum Offset' and 'Maximum Offset' parameters to determine the random offset range.

code_block = CodeBlock()
# ---------- code_block.designscript (11 lines) ----------
//global variables

def helpLink()
{
	return = "https://forms.office.com/Pages/ResponsePage.aspx?id=uTIU8X7PkEi0BHP28fj9b_7Z0NrgX9VIhN4eWRF1bs9UQU9QRUZMR0JONUdCOU5JS0QyTFIyNVhGNyQlQCN0PWcu";
};

def logo()
{
	return = "\\\\local.serapdx.com\\data\\Programs\\Autodesk\\pyRevit\user.extension\\SERA.tab\\Design.panel\\Family Placement.pulldown\\3 Point Family.pushbutton\\Images\\SERA.png";
};
# ----------------------------------------
code_block_2 = CodeBlock()
# ---------- code_block_2.designscript (20 lines) ----------
"Surface";
"Select Face";

//grid amount
2;
20;
"U Divisions";
"V Divisions";

//offset amount
0;
10;
0.1;
"Min Offset";
"Max Offset";

helpLink();
"Cancel";
logo();
400;
# ----------------------------------------
# note: OUTPUT
# GREEN = output data to Revit or associated file(s)
code_block_3 = CodeBlock { false; }
selectfaces_data = Custom[SelectFaces Data](InputName=code_block_2.out0, ButtonText=code_block_2.out1)  # package Data-Shapes; Creates a Revit face selection input for UI.MultipleInputForm++. Check out www.data-shapes.net for more infos!
slider = Custom[Slider](InputName=code_block_2.out4, Minimum=code_block_2.out2, Maximum=code_block_2.out3)  # package Data-Shapes; Creates slider input for UI.MultipleInputForm ++ . Set the step to decimal value if you want a double slider, or to a integer value if you want an integer slider.
slider_2 = Custom[Slider](InputName=code_block_2.out5, Minimum=code_block_2.out2, Maximum=code_block_2.out3)
string = StringInput("\\local.serapdx.com\data\Programs\Autodesk\pyRevit\user.extension\SERA.tab\Design.panel\Family Placement.pulldown\3 Point Family.pushbutton\Images\UV Divisions.png")
image_data = Custom[Image Data](Image=string, ShowBorder_optional=code_block_3)  # package Data-Shapes; Places an image on UI.MultipleInutForm ++ .
list_create = List.Create(item0=selectfaces_data, item1=slider, item2=slider_2, item3=image_data)
code_block_4 = CodeBlock { "3 Point Family Tessellation Tool"; true; "Continue"; }
# note: INPUT
# RED = input data from Revit or associated file(s)
# note: PROCESS
# YELLOW = processing portion of the algorithm
string_2 = StringInput("\\local.serapdx.com\data\Programs\Autodesk\pyRevit\user.extension\SERA.tab\Design.panel\Family Placement.pulldown\3 Point Family.pushbutton\Images\Input.gif")
image_data_2 = Custom[Image Data](Image=string_2, ShowBorder_optional=code_block_3)
multipleinputform = Custom[MultipleInputForm ++](Description_optional=code_block_4.out0, Logo_optional=code_block_2.out13, ButtonText_optional=code_block_4.out2, Inputs=image_data_2, Toggle=code_block_4.out1, LinkToHelp_optional=code_block_2.out11, CancelButtonText_optional=code_block_2.out12, Width_optional=code_block_2.out14)  # package Data-Shapes; Create a form with multiple inputs. see www.data-shapes.net for tutorials and infos!
not_ = Not(x=multipleinputform.Was_Cancelled)
multipleinputform_2 = Custom[MultipleInputForm ++](Logo_optional=code_block_2.out13, Inputs=list_create, Toggle=not_, LinkToHelp_optional=code_block_2.out11, Width_optional=code_block_2.out14)
load_3pt_family = Python()
# ---------- load_3pt_family.python (26 lines) ----------
import clr
clr.AddReference('RevitAPI')
from Autodesk.Revit.DB import *

clr.AddReference("RevitNodes")
import Revit
clr.ImportExtensions(Revit.Elements)

clr.AddReference("RevitServices")
import RevitServices
from RevitServices.Persistence import DocumentManager
from RevitServices.Transactions import TransactionManager

doc = DocumentManager.Instance.CurrentDBDocument
familyPath = r"S:\ProgramData\AutoDesk\Revit\2021\Libraries\US Imperial\Curtain Panel By Pattern\Triangle (flat) Surface.rfa"
familyName = "Triangle (flat) Surface"
elementList = []
booleans = []

TransactionManager.Instance.EnsureInTransaction(doc)

doc.LoadFamily(familyPath)

TransactionManager.Instance.TransactionTaskDone()
		
OUT = familyName
# ----------------------------------------
byName = Family.ByName(name=load_3pt_family)
slider_3 = Custom[Slider](InputName=code_block_2.out9, Minimum=code_block_2.out6, Maximum=code_block_2.out7)
slider_4 = Custom[Slider](InputName=code_block_2.out10, Minimum=code_block_2.out6, Maximum=code_block_2.out7)
string_3 = StringInput("\\local.serapdx.com\data\Programs\Autodesk\pyRevit\user.extension\SERA.tab\Design.panel\Family Placement.pulldown\3 Point Family.pushbutton\Images\Offset.png")
image_data_3 = Custom[Image Data](Image=string_3, ShowBorder_optional=code_block_3)
list_create_2 = List.Create(item0=slider_3, item1=slider_4, item2=image_data_3)
multipleinputform_3 = Custom[MultipleInputForm ++](Logo_optional=code_block_2.out13, Inputs=list_create_2, Toggle=multipleinputform_2.Was_Run, LinkToHelp_optional=code_block_2.out11, Width_optional=code_block_2.out14)
code_block_5 = CodeBlock(firstInput=multipleinputform_2.User_Inputs, fam=byName, secondInput=multipleinputform_3.User_Inputs)
# ---------- code_block_5.designscript (17 lines) ----------
//face
firstInput[0];

//family
Revit.Elements.Family.Types(fam)[1];

//u Grid
firstInput[1];

//v Grid
firstInput[2];

//minimum offset
secondInput[0];

//maximum offset
secondInput[1];
# ----------------------------------------
code_block_6 = CodeBlock(countU=code_block_5.out2, countV=code_block_5.out3) { 0..1..#countU; 0..1..#countV; }
pointAtParameter = Surface.PointAtParameter(surface=code_block_5.out0, u=code_block_6.out0, v=code_block_6.out1, lacing=CrossProduct)
doesIntersect = Geometry.DoesIntersect(geometry=pointAtParameter, other=code_block_5.out0)
filterByBoolMask = List.FilterByBoolMask(list=pointAtParameter, mask=doesIntersect)
count = List.Count(list=filterByBoolMask.in@@L2)
randomList = Math.RandomList(amount=count)
remapRange = Math.RemapRange(numbers=randomList, newMin=code_block_5.out4, newMax=code_block_5.out5)

# group: output messages
code_block_7 = CodeBlock { "And that's all there is to it."; "View Results"; }
string_4 = StringInput("\\local.serapdx.com\data\Programs\Autodesk\pyRevit\user.extension\SERA.tab\Design.panel\Family Placement.pulldown\3 Point Family.pushbutton\Images\Output.gif")
image_data_4 = Custom[Image Data](Image=string_4, ShowBorder_optional=code_block_3)
isNull = Object.IsNull(obj=pointAtParameter)
code_block_8 = CodeBlock { true; }
contains = List.Contains(list=isNull, item=code_block_8)
isNull_2 = Object.IsNull(obj=remapRange)
contains_2 = List.Contains(list=isNull_2, item=code_block_8)
or_ = contains || contains_2
not_2 = Not(x=or_)
code_block_9 = CodeBlock { helpLink(); }
python_script = Python(IN[0]=or_, IN[1]=multipleinputform.Was_Cancelled, IN[2]=code_block_9)
# ---------- python_script.python (19 lines) ----------
# python script to create dialog box

import clr
clr.AddReference('RevitAPIUI')

from Autodesk.Revit.UI import TaskDialog

bool = IN[0]
canceled = IN[1]
message = "Oops. Something went wrong. Please try again or select Help for assitance."
help = "<a href=\"" + IN[2] + "\">" + "Help</a>";

if bool and not canceled:
	dialog = TaskDialog('Result')
	dialog.TitleAutoPrefix = False
	dialog.MainContent = message
	dialog.FooterText = help

	result = dialog.Show()
# ----------------------------------------

normalAtPoint = Surface.NormalAtPoint(surface=code_block_5.out0, point=filterByBoolMask.in)
translate = Geometry.Translate(geometry=filterByBoolMask.in, direction=normalAtPoint, distance=remapRange)
pointgrid_totrisets = Custom[[&] PointGrid.ToTriSets](pointGrid=translate)  # package Ampersand; Construct three-point sets describing panels from a rectangular grid of points. May use a grid of points in the form of a diagrid. Boolean values "swapDiagDirection" and "alternateDiagsByRow" control how triangles are formed from the points. Boolean value "wrap"
byPoints = AdaptiveComponent.ByPoints(points=pointgrid_totrisets, familyType=code_block_5.out1)

# group: place objects, then run output message
isEmpty = List.IsEmpty(list=byPoints)
isNull_3 = Object.IsNull(obj=byPoints)
contains_3 = List.Contains(list=isNull_3, item=code_block_8)
or_2 = isEmpty || contains_3
not_3 = Not(x=or_2)
and_ = not_2 && not_3

# group (continued): output messages
multipleinputform_4 = Custom[MultipleInputForm ++](Description_optional=code_block_7.out0, Logo_optional=code_block_2.out13, ButtonText_optional=code_block_7.out1, Inputs=image_data_4, Toggle=and_, LinkToHelp_optional=code_block_2.out11, Width_optional=code_block_2.out14)
