# Dynamo graph 3point_script - Copy.dyn "3point_script" (Dynamo 2.6.1.8786)
# packages: Ampersand 2019.12.31, Data-Shapes 2021.2.94

# note: DYNAMO VERSION
# 2.6.1
# PACKAGE(S) / VERSION
# Ampersand / 2019.12.31
# ASSOCIATED FILE(S)
# 3-point Adaptive Family
# AUTHOR(S) / DATE
# Pete Heibel / March 2021
# DESCRIPTION
# Array a specified 3-point adaptive family across the selected surface.
# Adjust the 'U Grid' and 'V Grid' sliders to adjust the number of rows and columns.
# Adjust the 'Minimum Offset' and 'Maximum Offset' parameters to determine the random offset range.
# Toggle 'Attractor?' and use the 'Attractor' slider to manipulate where the panels begin to offset.
# Toggle 'Swap Diagonal Direction?' and/or 'Alternate Diagonals by Row?' to adjust the triangular array.
# IN PROGRESS
# Works with most selected surfaces (vertical or horizontal). Attractor point may not function intuitively depending on the angle of the surface.
# 3-point adaptive family contains a Panel_Mark text instance parameter. This script can be continued to determine how to automatically populate that parameter based on a panel's location. This information can be used for scheduling/installation purposes. The same concept can be used for the panel's material instance parameter as well.
# note: INPUT
# RED = input data from Revit or associated file(s)
# note: PROCESS
# YELLOW = processing portion of the algorithm
# note: OUTPUT
# GREEN = output data to Revit or associated file(s)

code_block = CodeBlock()
# ---------- code_block.designscript (20 lines) ----------
"Select Face";

//grid amount
1;
20;
"U Grid";
"V Grid";

//offset amount
0;
10;
0.1;
"Minimum Offset";
"Maximum Offset";

//attractor
0;
1;
0.01;
"Attractor";
# ----------------------------------------
selectfaces_data = Custom[SelectFaces Data](ButtonText=code_block.out0)  # package Data-Shapes; Creates a Revit face selection input for UI.MultipleInputForm++. Check out www.data-shapes.net for more infos!
code_block_2 = CodeBlock { "3-Point Family"; }
python_script = Python()
# ---------- python_script.python (30 lines) ----------
import clr
import sys
sys.path.append('C:\Program Files (x86)\IronPython 2.7\Lib')
import System
from System import Array
from System.Collections.Generic import *
clr.AddReference('ProtoGeometry')
from Autodesk.DesignScript.Geometry import *
clr.AddReference("RevitNodes")
import Revit
clr.ImportExtensions(Revit.Elements)
clr.ImportExtensions(Revit.GeometryConversion)
clr.AddReference("RevitServices")
import RevitServices
from RevitServices.Persistence import DocumentManager 
from RevitServices.Transactions import TransactionManager 

clr.AddReference("RevitAPI")
clr.AddReference("RevitAPIUI")

import Autodesk 
from Autodesk.Revit.DB import *
from Autodesk.Revit.UI import *

doc = DocumentManager.Instance.CurrentDBDocument
uiapp = DocumentManager.Instance.CurrentUIApplication 
app = uiapp.Application 
uidoc = uiapp.ActiveUIDocument

OUT = FilteredElementCollector(doc).OfClass(Family).ToElements()
# ----------------------------------------
types = Family.Types(family=python_script)
flatten = List.Flatten(list=types)
dropdown_data = Custom[DropDown Data](InputName=code_block_2, Keys=flatten, Values=flatten)  # package Data-Shapes; Create data for DropDown input in UI.MultiInputForm ++ . Check out www.data-shapes.net for more infos.
slider = Custom[Slider](InputName=code_block.out3, Minimum=code_block.out1, Maximum=code_block.out2)  # package Data-Shapes; Creates slider input for UI.MultipleInputForm ++ . Set the step to decimal value if you want a double slider, or to a integer value if you want an integer slider.
slider_2 = Custom[Slider](InputName=code_block.out4, Minimum=code_block.out1, Maximum=code_block.out2)
slider_3 = Custom[Slider](InputName=code_block.out8, Minimum=code_block.out5, Maximum=code_block.out6, Step=code_block.out7)
slider_4 = Custom[Slider](InputName=code_block.out9, Minimum=code_block.out5, Maximum=code_block.out6, Step=code_block.out7)
boolean_input = Custom[Boolean input](InputName=code_block.out13)  # package Data-Shapes; Creates a boolean input for UI.MultipleInputForm ++ . Check out www.data-shapes.net for more infos!
slider_5 = Custom[Slider](InputName=code_block.out13, Minimum=code_block.out10, Maximum=code_block.out11, Step=code_block.out12)
list_create = List.Create(item0=selectfaces_data, item1=dropdown_data, item2=slider, item3=slider_2, item4=slider_3, item5=slider_4, item6=boolean_input, item7=slider_5)
boolean = BoolSelector(true)
multipleinputform = Custom[MultipleInputForm ++](Inputs=list_create, Toggle=boolean)  # package Data-Shapes; Create a form with multiple inputs. see www.data-shapes.net for tutorials and infos!
code_block_3 = CodeBlock(inputs=multipleinputform.User_Inputs)
# ---------- code_block_3.designscript (23 lines) ----------
//face
inputs[0];

//family
inputs[1];

//u Grid
inputs[2];

//v Grid
inputs[3];

//minimum offset
inputs[4];

//maximum offset
inputs[5];

//attractor boolean
inputs[6];

//attractor value
inputs[7];
# ----------------------------------------
code_block_4 = CodeBlock(countU=code_block_3.out2, countV=code_block_3.out3) { 0..1..#countU; 0..1..#countV; }
pointAtParameter = Surface.PointAtParameter(surface=code_block_3.out0, u=code_block_4.out0, v=code_block_4.out1, lacing=CrossProduct)
doesIntersect = Geometry.DoesIntersect(geometry=pointAtParameter, other=code_block_3.out0)
# note: Attractor Point
filterByBoolMask = List.FilterByBoolMask(list=pointAtParameter, mask=doesIntersect)
normalAtPoint = Surface.NormalAtPoint(surface=code_block_3.out0, point=filterByBoolMask.in)
count = List.Count(list=filterByBoolMask.in@@L2)
randomList = Math.RandomList(amount=count)
remapRange = Math.RemapRange(numbers=randomList, newMin=code_block_3.out4, newMax=code_block_3.out5)
code_block_5 = CodeBlock(u=code_block_3.out7) { 1-u; 0.5; }
pointAtParameter_2 = Surface.PointAtParameter(surface=code_block_3.out0, u=code_block_5.out0, v=code_block_5.out1)
normalAtPoint_2 = Surface.NormalAtPoint(surface=code_block_3.out0, point=pointAtParameter_2)
code_block_6 = CodeBlock { 1000; -100; }
byStartPointDirectionLength = Line.ByStartPointDirectionLength(startPoint=pointAtParameter_2, direction=normalAtPoint_2, length=code_block_6.out0)
byCoordinates = Point.ByCoordinates(z=code_block_6.out1)
# note: project line from surface to intersect with plane at origin to determine if surface is horizontal or not
byOriginNormal = Plane.ByOriginNormal(origin=byCoordinates)
doesIntersect_2 = Geometry.DoesIntersect(geometry=byStartPointDirectionLength, other=byOriginNormal)
X = Point.X(point=filterByBoolMask.in)
X_2 = Point.X(point=pointAtParameter_2)
lt = X < X_2
Z = Point.Z(point=filterByBoolMask.in)
Z_2 = Point.Z(point=pointAtParameter_2)
lt_2 = Z < Z_2
code_block_7 = CodeBlock(isHorizontal=doesIntersect_2, compareX=lt, compareZ=lt_2)
# ---------- code_block_7.designscript (3 lines) ----------
isHorizontal?
	compareX:
	compareZ;
# ----------------------------------------
distanceTo = Geometry.DistanceTo(geometry=filterByBoolMask.in, other=pointAtParameter_2)
flatten_2 = List.Flatten(list=distanceTo)
remapRange_2 = Math.RemapRange(numbers=flatten_2)
count_2 = List.Count(list=distanceTo@L2)
chop = List.Chop(list=remapRange_2@L2, lengths=count_2)
code_block_8 = CodeBlock(flat=code_block_7, data=chop)
# ---------- code_block_8.designscript (5 lines) ----------
//determine which panels
//to flatten
flat?
	0:
	data;
# ----------------------------------------
mul = remapRange * code_block_8
code_block_9 = CodeBlock(attractor=code_block_3.out6, attractorData=mul, randomData=remapRange)
# ---------- code_block_9.designscript (3 lines) ----------
attractor?
	attractorData:
	randomData;
# ----------------------------------------
translate = Geometry.Translate(geometry=filterByBoolMask.in, direction=normalAtPoint, distance=code_block_9)
pointgrid_totrisets = Custom[[&] PointGrid.ToTriSets](pointGrid=translate)  # package Ampersand; Construct three-point sets describing panels from a rectangular grid of points. May use a grid of points in the form of a diagrid. Boolean values "swapDiagDirection" and "alternateDiagsByRow" control how triangles are formed from the points. Boolean value "wrap"
byPoints = AdaptiveComponent.ByPoints(points=pointgrid_totrisets, familyType=code_block_3.out1)
