# Dynamo graph 3point_script_with attractor.dyn "3point_script" (Dynamo 2.6.1.8786)
# packages: Ampersand 2019.12.31, Data-Shapes 2021.2.94

# note: DYNAMO VERSION
# 2.6.1
# PACKAGE(S) / VERSION
# Ampersand / 2019.12.31
# ASSOCIATED FILE(S)
# 3-point Adaptive Family
# AUTHOR(S) / DATE
# Pete Heibel / March 2021
# DESCRIPTION
# Array a specified 3-point adaptive family across the selected surface.
# Adjust the 'U Grid' and 'V Grid' sliders to adjust the number of rows and columns.
# Adjust the 'Minimum Offset' and 'Maximum Offset' parameters to determine the random offset range.
# Toggle 'Attractor?' and use the 'Attractor' slider to manipulate where the panels begin to offset.
# Toggle 'Swap Diagonal Direction?' and/or 'Alternate Diagonals by Row?' to adjust the triangular array.
# IN PROGRESS
# Works with most selected surfaces (vertical or horizontal). Attractor point may not function intuitively depending on the angle of the surface.
# 3-point adaptive family contains a Panel_Mark text instance parameter. This script can be continued to determine how to automatically populate that parameter based on a panel's location. This information can be used for scheduling/installation purposes. The same concept can be used for the panel's material instance parameter as well.

file_path = Filename("Images\SERA.png")
# note: INPUT
# RED = input data from Revit or associated file(s)
# note: PROCESS
# YELLOW = processing portion of the algorithm
code_block = CodeBlock()
# ---------- code_block.designscript (20 lines) ----------
"Select Face";

//grid amount
1;
20;
"U Divisions";
"V Divisions";

//offset amount
0;
10;
0.1;
"Minimum Offset";
"Maximum Offset";

//attractor
0;
1;
0.01;
"Attractor";
# ----------------------------------------
selectfaces_data = Custom[SelectFaces Data](ButtonText=code_block.out0)  # package Data-Shapes; Creates a Revit face selection input for UI.MultipleInputForm++. Check out www.data-shapes.net for more infos!
slider = Custom[Slider](InputName=code_block.out3, Minimum=code_block.out1, Maximum=code_block.out2)  # package Data-Shapes; Creates slider input for UI.MultipleInputForm ++ . Set the step to decimal value if you want a double slider, or to a integer value if you want an integer slider.
slider_2 = Custom[Slider](InputName=code_block.out4, Minimum=code_block.out1, Maximum=code_block.out2)
# note: OUTPUT
# GREEN = output data to Revit or associated file(s)
file_path_2 = Filename("Images\UV Divisions.png")
code_block_2 = CodeBlock { false; }
image_data = Custom[Image Data](Image=file_path_2, ShowBorder_optional=code_block_2)  # package Data-Shapes; Places an image on UI.MultipleInutForm ++ .
list_create = List.Create(item0=selectfaces_data, item1=slider, item2=slider_2, item3=image_data)
boolean = BoolSelector(true)
multipleinputform = Custom[MultipleInputForm ++](Logo_optional=file_path, Inputs=list_create, Toggle=boolean)  # package Data-Shapes; Create a form with multiple inputs. see www.data-shapes.net for tutorials and infos!
load_3pt_family_family = Python()
# ---------- load_3pt_family_family.python (26 lines) ----------
import clr
clr.AddReference('RevitAPI')
from Autodesk.Revit.DB import *

clr.AddReference("RevitNodes")
import Revit
clr.ImportExtensions(Revit.Elements)

clr.AddReference("RevitServices")
import RevitServices
from RevitServices.Persistence import DocumentManager
from RevitServices.Transactions import TransactionManager

doc = DocumentManager.Instance.CurrentDBDocument
familyPath = r"S:\ProgramData\AutoDesk\Revit\2021\Libraries\US Imperial\Curtain Panel By Pattern\Triangle (flat) Surface.rfa"
familyName = "Triangle (flat) Surface"
elementList = []
booleans = []

TransactionManager.Instance.EnsureInTransaction(doc)

doc.LoadFamily(familyPath)

TransactionManager.Instance.TransactionTaskDone()
		
OUT = familyName
# ----------------------------------------
byName = Family.ByName(name=load_3pt_family_family)
slider_3 = Custom[Slider](InputName=code_block.out8, Minimum=code_block.out5, Maximum=code_block.out6, Step=code_block.out7)
slider_4 = Custom[Slider](InputName=code_block.out9, Minimum=code_block.out5, Maximum=code_block.out6, Step=code_block.out7)
boolean_input = Custom[Boolean input](InputName=code_block.out13)  # package Data-Shapes; Creates a boolean input for UI.MultipleInputForm ++ . Check out www.data-shapes.net for more infos!
file_path_3 = Filename("Images\Offset.png")
image_data_2 = Custom[Image Data](Image=file_path_3, ShowBorder_optional=code_block_2)
list_create_2 = List.Create(item0=slider_3, item1=slider_4, item2=boolean_input, item3=image_data_2)
multipleinputform_2 = Custom[MultipleInputForm ++](Logo_optional=file_path, Inputs=list_create_2, Toggle=multipleinputform.Was_Run)
slider_5 = Custom[Slider](InputName=code_block.out13, Minimum=code_block.out10, Maximum=code_block.out11, Step=code_block.out12)
file_path_4 = Filename("Images\Attractor.png")
image_data_3 = Custom[Image Data](Image=file_path_4, ShowBorder_optional=code_block_2)
list_create_3 = List.Create(item0=slider_5, item1=image_data_3)
code_block_3 = CodeBlock(inputs=multipleinputform_2.User_Inputs) { inputs[2]; }
and_ = code_block_3 && multipleinputform_2.Was_Run
# note: set ButtonText
multipleinputform_3 = Custom[MultipleInputForm ++](Logo_optional=file_path, Inputs=list_create_3, Toggle=and_)
code_block_4 = CodeBlock { "Set toggle to true!"; }
eq = multipleinputform_3.User_Inputs == code_block_4
code_block_5 = CodeBlock(firstInput=multipleinputform.User_Inputs, fam=byName, secondInput=multipleinputform_2.User_Inputs, canceled=eq, thirdInput=multipleinputform_3.User_Inputs)
# ---------- code_block_5.designscript (23 lines) ----------
//face
firstInput[0];

//family
Family.Types(fam)[1];

//u Grid
firstInput[1];

//v Grid
firstInput[2];

//minimum offset
secondInput[0];

//maximum offset
secondInput[1];

//attractor boolean
secondInput[2];

//attractor value
canceled?0:thirdInput[0];
# ----------------------------------------
code_block_6 = CodeBlock(countU=code_block_5.out2, countV=code_block_5.out3) { 0..1..#countU; 0..1..#countV; }
pointAtParameter = Surface.PointAtParameter(surface=code_block_5.out0, u=code_block_6.out0, v=code_block_6.out1, lacing=CrossProduct)
doesIntersect = Geometry.DoesIntersect(geometry=pointAtParameter, other=code_block_5.out0)
filterByBoolMask = List.FilterByBoolMask(list=pointAtParameter, mask=doesIntersect)
normalAtPoint = Surface.NormalAtPoint(surface=code_block_5.out0, point=filterByBoolMask.in)
count = List.Count(list=filterByBoolMask.in@@L2)
randomList = Math.RandomList(amount=count)
remapRange = Math.RemapRange(numbers=randomList, newMin=code_block_5.out4, newMax=code_block_5.out5)
# note: add V variable rather than static 0.5
code_block_7 = CodeBlock(u=code_block_5.out7)
# ---------- code_block_7.designscript (4 lines) ----------
1-u;

//add V variable rather than static 0.5
0.5;
# ----------------------------------------
attractor_surface = Surface.PointAtParameter(surface=code_block_5.out0, u=code_block_7.out0, v=code_block_7.out1)
normalAtPoint_2 = Surface.NormalAtPoint(surface=code_block_5.out0, point=attractor_surface)
code_block_8 = CodeBlock { 1000; -100; }
byStartPointDirectionLength = Line.ByStartPointDirectionLength(startPoint=attractor_surface, direction=normalAtPoint_2, length=code_block_8.out0)
byCoordinates = Point.ByCoordinates(z=code_block_8.out1)
# note: project line from surface to intersect with plane at origin to determine if surface is horizontal or not
byOriginNormal = Plane.ByOriginNormal(origin=byCoordinates)
doesIntersect_2 = Geometry.DoesIntersect(geometry=byStartPointDirectionLength, other=byOriginNormal)
X = Point.X(point=filterByBoolMask.in)
X_2 = Point.X(point=attractor_surface)
lt = X < X_2
Z = Point.Z(point=filterByBoolMask.in)
Z_2 = Point.Z(point=attractor_surface)
lt_2 = Z < Z_2
code_block_9 = CodeBlock(isHorizontal=doesIntersect_2, compareX=lt, compareZ=lt_2)
# ---------- code_block_9.designscript (3 lines) ----------
isHorizontal?
	compareX:
	compareZ;
# ----------------------------------------
distanceTo = Geometry.DistanceTo(geometry=filterByBoolMask.in, other=attractor_surface)
flatten = List.Flatten(list=distanceTo)
remapRange_2 = Math.RemapRange(numbers=flatten)
count_2 = List.Count(list=distanceTo@L2)
chop = List.Chop(list=remapRange_2@L2, lengths=count_2)
code_block_10 = CodeBlock(flat=code_block_9, data=chop)
# ---------- code_block_10.designscript (5 lines) ----------
//determine which panels
//to flatten
flat?
	0:
	data;
# ----------------------------------------
mul = remapRange * code_block_10
code_block_11 = CodeBlock(attractor=code_block_3, attractorData=mul, randomData=remapRange)
# ---------- code_block_11.designscript (3 lines) ----------
attractor?
	attractorData:
	randomData;
# ----------------------------------------
translate = Geometry.Translate(geometry=filterByBoolMask.in, direction=normalAtPoint, distance=code_block_11)
pointgrid_totrisets = Custom[[&] PointGrid.ToTriSets](pointGrid=translate)  # package Ampersand; Construct three-point sets describing panels from a rectangular grid of points. May use a grid of points in the form of a diagrid. Boolean values "swapDiagDirection" and "alternateDiagsByRow" control how triangles are formed from the points. Boolean value "wrap"
byPoints = AdaptiveComponent.ByPoints(points=pointgrid_totrisets, familyType=code_block_5.out1)
doesIntersect_3 = Geometry.DoesIntersect(geometry=filterByBoolMask.in, other=code_block_5.out0)
filterByBoolMask_2 = List.FilterByBoolMask(list=filterByBoolMask.in, mask=doesIntersect_3)
