# Dynamo graph Define UV Direction_IN PROGRESS.dyn (Dynamo 2.6.1.8786)

select_face = DSFaceSelection()  # 1 picked in the model

# group: U
code_block = CodeBlock { 0; 0.5; 1; }
pointAtParameter = Surface.PointAtParameter(surface=select_face, u=code_block.out0, v=code_block.out1)
pointAtParameter_2 = Surface.PointAtParameter(surface=select_face, u=code_block.out2, v=code_block.out1)
byStartPointEndPoint = Line.ByStartPointEndPoint(startPoint=pointAtParameter, endPoint=pointAtParameter_2)
code_block_2 = CodeBlock { 1; 2; -1; }
byCoordinates = Point.ByCoordinates(x=code_block_2.out0, y=code_block_2.out1)
byCoordinates_2 = Point.ByCoordinates(x=code_block_2.out0)
byCoordinates_3 = Point.ByCoordinates(x=code_block_2.out2)
byCoordinates_4 = Point.ByCoordinates(x=code_block_2.out2, y=code_block_2.out1)
list_create = List.Create(item0=byCoordinates, item1=byCoordinates_2, item2=byCoordinates_3, item3=byCoordinates_4)
byPoints = PolyCurve.ByPoints(points=list_create)
byCoordinates_5 = Point.ByCoordinates()
byTwoPoints = Vector.ByTwoPoints(start=byCoordinates_5, end=pointAtParameter)
translate = Geometry.Translate(geometry=byPoints, direction=byTwoPoints)

# group: V
code_block_3 = CodeBlock { 0; 0.5; 1; }
pointAtParameter_3 = Surface.PointAtParameter(surface=select_face, u=code_block_3.out1, v=code_block_3.out0)
pointAtParameter_4 = Surface.PointAtParameter(surface=select_face, u=code_block_3.out1, v=code_block_3.out2)
byStartPointEndPoint_2 = Line.ByStartPointEndPoint(startPoint=pointAtParameter_3, endPoint=pointAtParameter_4)
code_block_4 = CodeBlock { 1; 2; -1; }
byCoordinates_6 = Point.ByCoordinates(x=code_block_4.out0, y=code_block_4.out1)
byCoordinates_7 = Point.ByCoordinates()
byCoordinates_8 = Point.ByCoordinates(x=code_block_4.out2, y=code_block_4.out1)
list_create_2 = List.Create(item0=byCoordinates_6, item1=byCoordinates_7, item2=byCoordinates_8)
byPoints_2 = PolyCurve.ByPoints(points=list_create_2)
byCoordinates_9 = Point.ByCoordinates()
byTwoPoints_2 = Vector.ByTwoPoints(start=byCoordinates_9, end=pointAtParameter_3)
translate_2 = Geometry.Translate(geometry=byPoints_2, direction=byTwoPoints_2)
