# Dynamo graph LinePlacement_script.dyn (Dynamo 2.12.0.5650)
# packages: Data-Shapes 2019.2.44, Data-Shapes 2021.2.94

# note: INPUT
# RED = input data from Revit or associated file(s)
# note: DYNAMO VERSION
# 2.6.1
# PACKAGE(S) / VERSION
# Data-Shapes
# ASSOCIATED FILE(S)
# AUTHOR(S) / DATE
# Max Archer / March 2021
# DESCRIPTION
# Family placement script on model line
# IN PROGRESS

# group: UI: start
code_block = CodeBlock { "LINE PLACEMENT?"; }
code_block_2 = CodeBlock { logo(); }
ui_image_data = Custom[UI.Image Data](Image=code_block_2)  # package Data-Shapes; Places an image on UI.MultipleInutForm ++ .
code_block_3 = CodeBlock { "RUN!"; }
string = StringInput("\\local.serapdx.com\data\Programs\Autodesk\pyRevit\user.extension\SERA.tab\Design.panel\Family Placement.pulldown\Line Placement.pushbutton\Images\Input.jpg")
ui_image_data_2 = Custom[UI.Image Data](Image=string)
boolean = BoolSelector(true)
code_block_4 = CodeBlock { helpLink(); }
code_block_5 = CodeBlock { "CANCEL?"; }
code_block_6 = CodeBlock { 600; }
ui_multipleinputform = Custom[UI.MultipleInputForm ++](Description_optional=code_block, Logo_optional=ui_image_data, ButtonText_optional=code_block_3, Inputs=ui_image_data_2, Toggle=boolean, LinkToHelp_optional=code_block_4, CancelButtonText_optional=code_block_5, Width_optional=code_block_6)  # package Data-Shapes; Create a form with multiple inputs. see www.data-shapes.net for tutorials and infos!

# group: UI: main
code_block_7 = CodeBlock { "LINE PLACEMENT GO!"; }
code_block_8 = CodeBlock { logo(); }
ui_image_data_3 = Custom[UI.Image Data](Image=code_block_8)
code_block_9 = CodeBlock { "PLACE!?"; }
code_block_10 = CodeBlock { "SELECT FAMILY"; "SELECT MODEL LINE"; true; }
selectmodelelements_data = Custom[SelectModelElements Data](ButtonText=code_block_10.out0, SelectSingleElement=code_block_10.out2)  # package Data-Shapes; Creates a Revit element selection input for UI.MultipleInputForm++ . Check out www.data-shapes.net for more infos!
selectmodelelements_data_2 = Custom[SelectModelElements Data](ButtonText=code_block_10.out1, SelectSingleElement=code_block_10.out2)
code_block_11 = CodeBlock { "FAMILY\nCOUNT"; 1; 100; 10; 1; }
slider = Custom[UI.Slider](InputName=code_block_11.out0, Minimum=code_block_11.out1, Maximum=code_block_11.out2, Default_Value=code_block_11.out3, Step=code_block_11.out4)  # package Data-Shapes; Creates slider input for UI.MultipleInputForm ++ . Set the step to decimal value if you want a double slider, or to a integer value if you want an integer slider.
code_block_12 = CodeBlock { "END\nOFFSET\n(INCHES)"; 0; 240; 12; 1; }
slider_2 = Custom[UI.Slider](InputName=code_block_12.out0, Minimum=code_block_12.out1, Maximum=code_block_12.out2, Default_Value=code_block_12.out3, Step=code_block_12.out4)
list_create = List.Create(item0=selectmodelelements_data, item1=selectmodelelements_data_2, item2=slider, item3=slider_2)
not_ = Not(x=ui_multipleinputform.Was_Cancelled)
ui_multipleinputform_2 = Custom[UI.MultipleInputForm ++](Description_optional=code_block_7, Logo_optional=ui_image_data_3, ButtonText_optional=code_block_9, Inputs=list_create, Toggle=not_)

# group: input + output point
flatten = List.Flatten(list=ui_multipleinputform_2.User_Inputs)
code_block_13 = CodeBlock(inputs=flatten)
# ---------- code_block_13.designscript (11 lines) ----------
//family
inputs[0];

//line
inputs[1];

//NUMBER OF FAMILIES
inputs[2];

//OFFSET?
inputs[3];
# ----------------------------------------

# group: line to geometry
geometry = Element.Geometry(element=code_block_13.out1)

# group: convert to inches
code_block_14 = CodeBlock(X=code_block_13.out3) { X; }
startPoint = Curve.StartPoint(curve=geometry)
code_block_15 = CodeBlock { 0.01; }
pointAtParameter = Curve.PointAtParameter(curve=geometry, param=code_block_15)
byStartPointEndPoint = Line.ByStartPointEndPoint(startPoint=startPoint, endPoint=pointAtParameter)
length = Curve.Length(curve=byStartPointEndPoint)
code_block_16 = CodeBlock(x=length) { x*100; }
convert_between_units = DynamoConvert(code_block_16, MeasurementType="Length", FromConversion="Feet", ToConversion="Inches")
flatten_2 = List.Flatten(list=convert_between_units)
code_block_17 = CodeBlock(x=code_block_14, y=flatten_2) { x/y; }
watch = Watch(code_block_17)
code_block_18 = CodeBlock(x=watch, amount=code_block_13.out2)
# ---------- code_block_18.designscript (2 lines) ----------
//point on line, step code
(0+x)..(1-x)..#amount;
# ----------------------------------------

# group: place family by point
elementType = Element.ElementType(element=code_block_13.out0)
pointAtParameter_2 = Curve.PointAtParameter(curve=geometry, param=code_block_18@L1, lacing=Longest)
byPoint = FamilyInstance.ByPoint(familyType=elementType, point=pointAtParameter_2, lacing=CrossProduct)

# group: rotate family tangent to line
tangentAtParameter = Curve.TangentAtParameter(curve=geometry, param=code_block_18)
XAxis = Vector.XAxis()
ZAxis = Vector.ZAxis()
angleAboutAxis = Vector.AngleAboutAxis(vector=tangentAtParameter, otherVector=XAxis, rotationAxis=ZAxis)
flatten_3 = List.Flatten(list=angleAboutAxis)
setRotation = FamilyInstance.SetRotation(familyInstance=byPoint, degree=flatten_3)

# group: UI: end
code_block_19 = CodeBlock { "WELL DONE, HOPE IT WORKED!"; "Okay"; }
code_block_20 = CodeBlock { logo(); }
ui_image_data_4 = Custom[UI.Image Data](Image=code_block_20)
string_2 = StringInput("\\local.serapdx.com\data\Programs\Autodesk\pyRevit\user.extension\SERA.tab\Design.panel\Family Placement.pulldown\Line Placement.pushbutton\Images\Output.gif")
image_data = Custom[Image Data](Image=string_2)  # package Data-Shapes; Places an image on UI.MultipleInutForm ++ .
isNull = Object.IsNull(object=setRotation)
code_block_21 = CodeBlock { true; }
contains = List.Contains(list=isNull, item=code_block_21)
isEmpty = List.IsEmpty(list=setRotation)
or_ = contains || isEmpty
not_2 = Not(x=or_)
code_block_22 = CodeBlock { helpLink(); }
multipleinputform = Custom[MultipleInputForm ++](Description_optional=code_block_19.out0, Logo_optional=ui_image_data_4, ButtonText_optional=code_block_19.out1, Inputs=image_data, Toggle=not_2, LinkToHelp_optional=code_block_22)  # package Data-Shapes; Create a form with multiple inputs. see www.data-shapes.net for tutorials and infos!

# group: UI: error message
gif_was_run = Watch(multipleinputform.Was_Run)
ui_start_was_cancelled = Watch(ui_multipleinputform.Was_Cancelled)
code_block_23 = CodeBlock { helpLink(); }
python_script = Python(IN[0]=gif_was_run, IN[1]=ui_start_was_cancelled, IN[2]=code_block_23)  # IronPython2
# ---------- python_script.python (19 lines) ----------
# python script to create dialog box

import clr
clr.AddReference('RevitAPIUI')

from Autodesk.Revit.UI import TaskDialog

gifWasRun = IN[0]
UIstartWasCanceled = IN[1]
message = "Oops. Something went wrong. Please try again or select Help for assitance."
help = "<a href=\"" + IN[2] + "\">" + "Help</a>";

if not gifWasRun and not UIstartWasCanceled:
	dialog = TaskDialog('Result')
	dialog.TitleAutoPrefix = False
	dialog.MainContent = message
	dialog.FooterText = help

	result = dialog.Show()
# ----------------------------------------

# note: PROCESS
# YELLOW = processing portion of the algorithm
# note: OUTPUT
# GREEN = output data to Revit or associated file(s)
code_block_24 = CodeBlock()
# ---------- code_block_24.designscript (11 lines) ----------
//global variables

def helpLink()
{
	return = "https://forms.office.com/Pages/ResponsePage.aspx?id=uTIU8X7PkEi0BHP28fj9b_7Z0NrgX9VIhN4eWRF1bs9UQU9QRUZMR0JONUdCOU5JS0QyTFIyNVhGNyQlQCN0PWcu";
};

def logo()
{
	return = "\\\\local.serapdx.com\\data\\Programs\\Autodesk\\pyRevit\user.extension\\SERA.tab\\Design.panel\\Family Placement.pulldown\\3 Point Family.pushbutton\\Images\\SERA.png";
};
# ----------------------------------------
