# Dynamo graph 2021_0505 - LinePlacement_script.dyn "LinePlacement_script" (Dynamo 2.3.0.5885)
# packages: Data-Shapes 2019.2.44

code_block = CodeBlock { "LINE PLACEMENT GO!"; }
code_block_2 = CodeBlock { "PHASE 2"; }
code_block_3 = CodeBlock { "FAMILY"; }
ui_selectmodelelements_data = Custom[UI.SelectModelElements Data](InputName=code_block_3, ButtonText=code_block_3)  # package Data-Shapes; Creates a Revit element selection input for UI.MultipleInputForm++ . Check out www.data-shapes.net for more infos!
code_block_4 = CodeBlock { "SELECT MODEL LINE"; }
code_block_5 = CodeBlock { "LINE"; }
categories = Categories("OST_Lines")
ui_selectmodelelements_data_2 = Custom[UI.SelectModelElements Data](InputName=code_block_4, ButtonText=code_block_5, CategoryFilter=categories)
code_block_6 = CodeBlock { "NUMBER OF FAMILIES"; 1; 100; 10; 1; }
slider = Custom[UI.Slider](InputName=code_block_6.out0, Minimum=code_block_6.out1, Maximum=code_block_6.out2, Default_Value=code_block_6.out3, Step=code_block_6.out4)  # package Data-Shapes; Creates slider input for UI.MultipleInputForm ++ . Set the step to decimal value if you want a double slider, or to a integer value if you want an integer slider.
code_block_7 = CodeBlock { "ROTATE / OFFSET?"; }
ui_boolean_input = Custom[UI.Boolean input](InputName=code_block_7)  # package Data-Shapes; Creates a boolean input for UI.MultipleInputForm ++ . Check out www.data-shapes.net for more infos!
list_create = List.Create(item0=ui_selectmodelelements_data, item1=ui_selectmodelelements_data_2, item2=slider, item3=ui_boolean_input)

# group: openning
code_block_8 = CodeBlock { "LINE PLACEMENT?"; }
file_path = Filename(".\LINE PLACEMENT EXAMPLE.jpg")
ui_image_data = Custom[UI.Image Data](Image=file_path)  # package Data-Shapes; Places an image on UI.MultipleInutForm ++ .
code_block_9 = CodeBlock { "RUN!"; }
list_create_2 = List.Create(item0=ui_image_data)
boolean = BoolSelector(true)
code_block_10 = CodeBlock { "CANCEL?"; }
ui_multipleinputform = Custom[UI.MultipleInputForm ++](Description_optional=code_block_8, Logo_optional=ui_image_data, ButtonText_optional=code_block_9, Inputs=list_create_2, Toggle=boolean, CancelButtonText_optional=code_block_10)  # package Data-Shapes; Create a form with multiple inputs. see www.data-shapes.net for tutorials and infos!
watch = Watch(ui_multipleinputform.Was_Cancelled)
boolean_2 = BoolSelector(false)
boolean_3 = BoolSelector(true)
code_block_11 = CodeBlock(x=watch, y=boolean_2, z=boolean_3) { (x?y:z); }
watch_2 = Watch(code_block_11)

ui_multipleinputform_2 = Custom[UI.MultipleInputForm ++](Description_optional=code_block, ButtonText_optional=code_block_2, Inputs=list_create@L2, Toggle=watch_2)
flatten = List.Flatten(list=ui_multipleinputform_2.User_Inputs)
watch_3 = Watch(flatten)
code_block_12 = CodeBlock(inputs=watch_3)
# ---------- code_block_12.designscript (11 lines) ----------
//family
inputs[0];

//line
inputs[1];

//NUMBER OF FAMILIES
inputs[2];

//ROTATE/OFFSET?
inputs[3];
# ----------------------------------------
watch_4 = Watch(code_block_12.out0)
elementType = Element.ElementType(element=watch_4)
watch_5 = Watch(code_block_12.out1)
geometry = Element.Geometry(element=watch_5)
code_block_13 = CodeBlock { "ROTATION + OFFSET DIAGLOG"; }
code_block_14 = CodeBlock()
# ---------- code_block_14.designscript (4 lines) ----------
"HOW?";

["PERPENDICULAR TO LINE", "TANGENT TO LINE",
"RANDOM", "SET ROTATION"];
# ----------------------------------------
ui_radiobuttons_data = Custom[UI.RadioButtons Data](InputName=code_block_14.out0, Keys=code_block_14.out1, Values=code_block_14.out1)  # package Data-Shapes; Create radio buttons input for UI.MultipleInputForm ++ .
code_block_15 = CodeBlock { "OFFSET FROM CURVE ENDS (INCHES)"; 0.0; 240; 12; 1; }
slider_2 = Custom[UI.Slider](InputName=code_block_15.out0, Minimum=code_block_15.out1, Maximum=code_block_15.out2, Default_Value=code_block_15.out3, Step=code_block_15.out4)
code_block_16 = CodeBlock { "REVERSE CURVE?"; FALSE; }  # unwired: FALSE
ui_boolean_input_2 = Custom[UI.Boolean input](InputName=code_block_16.out0, DefaultValue=code_block_16.FALSE)
list_create_3 = List.Create(item0=ui_radiobuttons_data, item1=slider_2, item2=ui_boolean_input_2)
ui_multipleinputform_3 = Custom[UI.MultipleInputForm ++](Description_optional=code_block_13, Inputs=list_create_3, Toggle=code_block_12.out3)
code_block_17 = CodeBlock(inputs=ui_multipleinputform_3.User_Inputs)
# ---------- code_block_17.designscript (9 lines) ----------
//PERPEDICULAR

inputs[0];

//OFFSET FROM CURVE ENDS
inputs[1];

//REVERSE CURVE?
inputs[3];
# ----------------------------------------
watch_6 = Watch(code_block_17.out2)

# group: convert offset to inch
watch_7 = Watch(geometry)
startPoint = Curve.StartPoint(curve=watch_7)
code_block_18 = CodeBlock { 0.01; }
pointAtParameter = Curve.PointAtParameter(curve=watch_7, param=code_block_18)
byStartPointEndPoint = Line.ByStartPointEndPoint(startPoint=startPoint, endPoint=pointAtParameter)
length = Curve.Length(curve=byStartPointEndPoint)
code_block_19 = CodeBlock(x=length) { x*100; }
convert_between_units = DynamoConvert(code_block_19, MeasurementType="Length", FromConversion="Feet", ToConversion="Inches")
flatten_2 = List.Flatten(list=convert_between_units)
code_block_20 = CodeBlock(x=code_block_17.out1, y=flatten_2) { x/y; }
watch_8 = Watch(code_block_20)

watch_9 = Watch(watch_8)
watch_10 = Watch(code_block_12.out2)
code_block_21 = CodeBlock(x=watch_9, amount=watch_10) { (0+x)..(1-x)..#amount; }
reverse = List.Reverse(list=code_block_21)
watch_11 = Watch(reverse)
watch_12 = Watch(code_block_21)
code_block_22 = CodeBlock(reverseList=watch_6, listReversed=watch_11, list=watch_12) { reverseList?listReversed:list; }
pointAtParameter_2 = Curve.PointAtParameter(curve=geometry, param=code_block_22@L1, lacing=Longest)
watch_13 = Watch(pointAtParameter_2)
byPoint = FamilyInstance.ByPoint(familyType=elementType, point=watch_13, lacing=CrossProduct)
watch_14 = Watch(code_block_22)
normalAtParameter = Curve.NormalAtParameter(curve=watch_13, param=watch_14)
XAxis = Vector.XAxis()
ZAxis = Vector.ZAxis()
angleAboutAxis = Vector.AngleAboutAxis(vector=normalAtParameter, otherVector=XAxis, rotationAxis=ZAxis)
setRotation = FamilyInstance.SetRotation(familyInstance=byPoint, degree=angleAboutAxis)
code_block_23 = CodeBlock()  # // input of feet, convert to 10% xx normal value
code_block_24 = CodeBlock { "HOT DARN YOU BROKE THE FAMILY TYPES SELECTION"; }
code_block_25 = CodeBlock { "BLAME MAX"; }
isNull = Object.IsNull(obj=elementType)
watch_15 = Watch(isNull)
code_block_26 = CodeBlock { "TRY AGAIN"; }
ui_multipleinputform_4 = Custom[UI.MultipleInputForm ++](Description_optional=code_block_24, ButtonText_optional=code_block_25, Toggle=watch_15, CancelButtonText_optional=code_block_26)  # unwired: Inputs
byTangency = Line.ByTangency(curve=watch_13, parameter=watch_14)
XAxis_2 = Vector.XAxis()
ZAxis_2 = Vector.ZAxis()
angleAboutAxis_2 = Vector.AngleAboutAxis(vector=byTangency, otherVector=XAxis_2, rotationAxis=ZAxis_2)
code_block_27 = CodeBlock()  # // NEED TO WORK OUT ROTATION OPTIONS
code_block_28 = CodeBlock()  # // AUTO LOAD FAMILY HERE?
code_block_29 = CodeBlock(X=code_block_17.out0) { X; }
code_block_30 = CodeBlock()  # //select family type
code_block_31 = CodeBlock {  }
type = Object.Type(obj=ui_selectmodelelements_data)
