# Dynamo graph 2021_0609 - LinePlacement_script.dyn "LinePlacement_script" (Dynamo 2.6.1.8786)
# packages: Data-Shapes 2019.2.44

# note: INPUT
# RED = input data from Revit or associated file(s)
# note: PROCESS
# YELLOW = processing portion of the algorithm
# note: DYNAMO VERSION
# 2.6.1
# PACKAGE(S) / VERSION
# Data-Shapes
# ASSOCIATED FILE(S)
# AUTHOR(S) / DATE
# Max Archer / March 2021
# DESCRIPTION
# IN PROGRESS
# note: OUTPUT
# GREEN = output data to Revit or associated file(s)

# group: main input form
code_block = CodeBlock { "LINE PLACEMENT GO!"; }
code_block_2 = CodeBlock { "PHASE 2"; }
code_block_3 = CodeBlock { "FAMILY"; }
ui_selectmodelelements_data = Custom[UI.SelectModelElements Data](InputName=code_block_3, ButtonText=code_block_3)  # package Data-Shapes; Creates a Revit element selection input for UI.MultipleInputForm++ . Check out www.data-shapes.net for more infos!
code_block_4 = CodeBlock { "SELECT MODEL LINE"; }
code_block_5 = CodeBlock { "LINE"; }
categories = Categories("OST_Lines")
ui_selectmodelelements_data_2 = Custom[UI.SelectModelElements Data](InputName=code_block_4, ButtonText=code_block_5, CategoryFilter=categories)
code_block_6 = CodeBlock { "NUMBER OF FAMILIES"; 1; 100; 10; 1; }
slider = Custom[UI.Slider](InputName=code_block_6.out0, Minimum=code_block_6.out1, Maximum=code_block_6.out2, Default_Value=code_block_6.out3, Step=code_block_6.out4)  # package Data-Shapes; Creates slider input for UI.MultipleInputForm ++ . Set the step to decimal value if you want a double slider, or to a integer value if you want an integer slider.
code_block_7 = CodeBlock { "ROTATE / OFFSET?"; }
code_block_8 = CodeBlock { "OFFSET FROM CURVE ENDS (INCHES)"; 0.0; 240; 12; 1; }
slider_2 = Custom[UI.Slider](InputName=code_block_8.out0, Minimum=code_block_8.out1, Maximum=code_block_8.out2, Default_Value=code_block_8.out3, Step=code_block_8.out4)
code_block_9 = CodeBlock { "REVERSE CURVE?"; FALSE; }  # unwired: FALSE
ui_boolean_input = Custom[UI.Boolean input](InputName=code_block_9.out0, DefaultValue=code_block_9.FALSE)  # package Data-Shapes; Creates a boolean input for UI.MultipleInputForm ++ . Check out www.data-shapes.net for more infos!
code_block_10 = CodeBlock()  # //select family type
type = Object.Type(obj=ui_selectmodelelements_data)

# group: NOTE
# note: Boolean node does not display toggle radio buttons. Need to test/look into.
ui_boolean_input_2 = Custom[UI.Boolean input](InputName=code_block_7)

# group (continued): main input form
list_create = List.Create(item0=ui_selectmodelelements_data, item1=ui_selectmodelelements_data_2, item2=slider, item3=ui_boolean_input_2)

# group: NOTE
# note: Reminder: Update paths when moving to final location within SERA tab.
string = StringInput("C:\Users\peteh\OneDrive - SERA Architects\pyRevit\Dynamo.extension\Dynamo.tab\Tools.panel\Family Placement.pulldown\SERA.png")
# note: Make image larger or remove: too difficult to read what is going on.
# OR
# Add more detailed description of what this tool does.
string_2 = StringInput("C:\Users\peteh\OneDrive - SERA Architects\BIM\_Shared\pyRevit\Dynamo.extension\Dynamo.tab\Tools.panel\Family Placement.pulldown\Line Placement.pushbutton\Images\LINE PLACEMENT EXAMPLE.jpg")

# group: NOTE
# note: Update to this URL:
# https://vm-servicedesk.serapdx.com:8082/WorkOrder.do?woMode=newWO&reqTemplate=200000001
code_block_11 = CodeBlock { "https://vm-servicedesk.serapdx.com:8082/ESM.do?type=portal"; }

# group: Open - proceed with run?
# note: may remove this section, is a little redundant
code_block_12 = CodeBlock { "LINE PLACEMENT?"; }
ui_image_data = Custom[UI.Image Data](Image=string)  # package Data-Shapes; Places an image on UI.MultipleInutForm ++ .
code_block_13 = CodeBlock { "RUN!"; }
ui_image_data_2 = Custom[UI.Image Data](Image=string_2)
list_create_2 = List.Create(item0=ui_image_data_2)
boolean = BoolSelector(true)
code_block_14 = CodeBlock { "CANCEL?"; }
ui_multipleinputform = Custom[UI.MultipleInputForm ++](Description_optional=code_block_12, Logo_optional=ui_image_data, ButtonText_optional=code_block_13, Inputs=list_create_2, Toggle=boolean, LinkToHelp_optional=code_block_11, CancelButtonText_optional=code_block_14)  # package Data-Shapes; Create a form with multiple inputs. see www.data-shapes.net for tutorials and infos!
watch = Watch(ui_multipleinputform.Was_Cancelled)
boolean_2 = BoolSelector(false)
boolean_3 = BoolSelector(true)

# group: NOTE
# note: What is the purpose of this IF statement?
code_block_15 = CodeBlock(x=watch, y=boolean_2, z=boolean_3) { (x?y:z); }

# group (continued): Open - proceed with run?
watch_2 = Watch(code_block_15)

# group: input + output point
ui_multipleinputform_2 = Custom[UI.MultipleInputForm ++](Description_optional=code_block, ButtonText_optional=code_block_2, Inputs=list_create@L2, Toggle=watch_2)
flatten = List.Flatten(list=ui_multipleinputform_2.User_Inputs)
watch_3 = Watch(flatten)
code_block_16 = CodeBlock(inputs=watch_3)
# ---------- code_block_16.designscript (11 lines) ----------
//family
inputs[0];

//line
inputs[1];

//NUMBER OF FAMILIES
inputs[2];

//ROTATE/OFFSET?
inputs[3];
# ----------------------------------------

watch_4 = Watch(code_block_16.out0)
elementType = Element.ElementType(element=watch_4)
watch_5 = Watch(code_block_16.out1)
geometry = Element.Geometry(element=watch_5)

# group: placement form
code_block_17 = CodeBlock { "ROTATION + OFFSET DIAGLOG"; }
code_block_18 = CodeBlock()
# ---------- code_block_18.designscript (4 lines) ----------
"HOW?";

["PERPENDICULAR TO LINE", "TANGENT TO LINE",
"RANDOM", "SET ROTATION"];
# ----------------------------------------
ui_radiobuttons_data = Custom[UI.RadioButtons Data](InputName=code_block_18.out0, Keys=code_block_18.out1, Values=code_block_18.out1)  # package Data-Shapes; Create radio buttons input for UI.MultipleInputForm ++ .
list_create_3 = List.Create(item0=ui_radiobuttons_data, item1=slider_2, item2=ui_boolean_input)
ui_multipleinputform_3 = Custom[UI.MultipleInputForm ++](Description_optional=code_block_17, Inputs=list_create_3, Toggle=code_block_16.out3)
code_block_19 = CodeBlock(inputs=ui_multipleinputform_3.User_Inputs)
# ---------- code_block_19.designscript (9 lines) ----------
//PERPEDICULAR

inputs[0];

//OFFSET FROM CURVE ENDS
inputs[1];

//REVERSE CURVE?
inputs[3];
# ----------------------------------------

# group: convert offset to inch
watch_6 = Watch(geometry)
startPoint = Curve.StartPoint(curve=watch_6)
code_block_20 = CodeBlock { 0.01; }
pointAtParameter = Curve.PointAtParameter(curve=watch_6, param=code_block_20)
byStartPointEndPoint = Line.ByStartPointEndPoint(startPoint=startPoint, endPoint=pointAtParameter)
length = Curve.Length(curve=byStartPointEndPoint)
code_block_21 = CodeBlock(x=length) { x*100; }
convert_between_units = DynamoConvert(code_block_21, MeasurementType="Length", FromConversion="Feet", ToConversion="Inches")
flatten_2 = List.Flatten(list=convert_between_units)
code_block_22 = CodeBlock(x=code_block_19.out1, y=flatten_2) { x/y; }
watch_7 = Watch(code_block_22)

# group: reverse / don't reverse
watch_8 = Watch(code_block_19.out2)
watch_9 = Watch(watch_7)
watch_10 = Watch(code_block_16.out2)
code_block_23 = CodeBlock(x=watch_9, amount=watch_10) { (0+x)..(1-x)..#amount; }
reverse = List.Reverse(list=code_block_23)
watch_11 = Watch(reverse)
watch_12 = Watch(code_block_23)
code_block_24 = CodeBlock(reverseList=watch_8, listReversed=watch_11, list=watch_12) { reverseList?listReversed:list; }

pointAtParameter_2 = Curve.PointAtParameter(curve=geometry, param=code_block_24@L1, lacing=Longest)
watch_13 = Watch(pointAtParameter_2)
watch_14 = Watch(code_block_24)

# group: place family instance + rotate
byPoint = FamilyInstance.ByPoint(familyType=elementType, point=watch_13, lacing=CrossProduct)
normalAtParameter = Curve.NormalAtParameter(curve=watch_13, param=watch_14)
XAxis = Vector.XAxis()
ZAxis = Vector.ZAxis()
angleAboutAxis = Vector.AngleAboutAxis(vector=normalAtParameter, otherVector=XAxis, rotationAxis=ZAxis)
setRotation = FamilyInstance.SetRotation(familyInstance=byPoint, degree=angleAboutAxis)
byTangency = Line.ByTangency(curve=watch_13, parameter=watch_14)
XAxis_2 = Vector.XAxis()
ZAxis_2 = Vector.ZAxis()
angleAboutAxis_2 = Vector.AngleAboutAxis(vector=byTangency, otherVector=XAxis_2, rotationAxis=ZAxis_2)
code_block_25 = CodeBlock()  # // NEED TO WORK OUT ROTATION OPTIONS
code_block_26 = CodeBlock(X=code_block_19.out0) { X; }

# group: null family use loaded family form
code_block_27 = CodeBlock { "HOT DARN YOU BROKE THE FAMILY TYPES SELECTION"; }
code_block_28 = CodeBlock { "BLAME MAX"; }
isNull = Object.IsNull(obj=elementType)
watch_15 = Watch(isNull)
code_block_29 = CodeBlock { "TRY AGAIN"; }
ui_multipleinputform_4 = Custom[UI.MultipleInputForm ++](Description_optional=code_block_27, ButtonText_optional=code_block_28, Toggle=watch_15, CancelButtonText_optional=code_block_29)  # unwired: Inputs
code_block_30 = CodeBlock()  # // AUTO LOAD FAMILY HERE?
load_column = Python()
# ---------- load_column.python (26 lines) ----------
import clr
clr.AddReference('RevitAPI')
from Autodesk.Revit.DB import *

clr.AddReference("RevitNodes")
import Revit
clr.ImportExtensions(Revit.Elements)

clr.AddReference("RevitServices")
import RevitServices
from RevitServices.Persistence import DocumentManager
from RevitServices.Transactions import TransactionManager

doc = DocumentManager.Instance.CurrentDBDocument
familyPath = r"S:\S:\ProgramData\AutoDesk\Revit\2021\Libraries\US Imperial\Columns\Rectangular Column.rfa"
familyName = "Rectangular Column"
elementList = []
booleans = []

TransactionManager.Instance.EnsureInTransaction(doc)

doc.LoadFamily(familyPath)

TransactionManager.Instance.TransactionTaskDone()
		
OUT = familyName
# ----------------------------------------
