# Dynamo graph LinePlacement_script.dyn (Dynamo 2.6.1.8786)
# packages: Data-Shapes 2019.2.44

# note: INPUT
# RED = input data from Revit or associated file(s)
# note: PROCESS
# YELLOW = processing portion of the algorithm
# note: DYNAMO VERSION
# 2.6.1
# PACKAGE(S) / VERSION
# Data-Shapes
# ASSOCIATED FILE(S)
# AUTHOR(S) / DATE
# Max Archer / March 2021
# DESCRIPTION
# IN PROGRESS
# note: OUTPUT
# GREEN = output data to Revit or associated file(s)

code_block = CodeBlock { "LINE PLACEMENT GO!"; }
code_block_2 = CodeBlock { "PHASE 2"; }
code_block_3 = CodeBlock { "FAMILY"; }
ui_selectmodelelements_data = Custom[UI.SelectModelElements Data](InputName=code_block_3, ButtonText=code_block_3)  # package Data-Shapes; Creates a Revit element selection input for UI.MultipleInputForm++ . Check out www.data-shapes.net for more infos!
code_block_4 = CodeBlock()
# ---------- code_block_4.designscript (2 lines) ----------
"SELECT
MODEL LINE";
# ----------------------------------------
code_block_5 = CodeBlock { "LINE"; }
categories = Categories("OST_Lines")
ui_selectmodelelements_data_2 = Custom[UI.SelectModelElements Data](InputName=code_block_4, ButtonText=code_block_5, CategoryFilter=categories)
code_block_6 = CodeBlock { "NUMBER OF FAMILIES"; 1; 100; 10; 1; }
slider = Custom[UI.Slider](InputName=code_block_6.out0, Minimum=code_block_6.out1, Maximum=code_block_6.out2, Default_Value=code_block_6.out3, Step=code_block_6.out4)  # package Data-Shapes; Creates slider input for UI.MultipleInputForm ++ . Set the step to decimal value if you want a double slider, or to a integer value if you want an integer slider.
code_block_7 = CodeBlock { "OFFSET?"; }
ui_boolean_input = Custom[UI.Boolean input](InputName=code_block_7)  # package Data-Shapes; Creates a boolean input for UI.MultipleInputForm ++ . Check out www.data-shapes.net for more infos!
list_create = List.Create(item0=ui_selectmodelelements_data, item1=ui_selectmodelelements_data_2, item2=slider, item3=ui_boolean_input)
code_block_8 = CodeBlock { "LINE PLACEMENT?"; }
file_path = Filename("..\SERA.png")
ui_image_data = Custom[UI.Image Data](Image=file_path)  # package Data-Shapes; Places an image on UI.MultipleInutForm ++ .
code_block_9 = CodeBlock { "RUN!"; }
file_path_2 = Filename("Images\lineplacement.jpg")
ui_image_data_2 = Custom[UI.Image Data](Image=file_path_2)
list_create_2 = List.Create(item0=ui_image_data_2)
boolean = BoolSelector(true)
code_block_10 = CodeBlock { "https://vm-servicedesk.serapdx.com:8082/ESM.do?type=portal"; }
code_block_11 = CodeBlock { "CANCEL?"; }
code_block_12 = CodeBlock { 600; }
ui_multipleinputform = Custom[UI.MultipleInputForm ++](Description_optional=code_block_8, Logo_optional=ui_image_data, ButtonText_optional=code_block_9, Inputs=list_create_2, Toggle=boolean, LinkToHelp_optional=code_block_10, CancelButtonText_optional=code_block_11, Width_optional=code_block_12)  # package Data-Shapes; Create a form with multiple inputs. see www.data-shapes.net for tutorials and infos!
not_ = Not(x=ui_multipleinputform.Was_Cancelled)

# group: input + output point
ui_multipleinputform_2 = Custom[UI.MultipleInputForm ++](Description_optional=code_block, ButtonText_optional=code_block_2, Inputs=list_create@L2, Toggle=not_)
flatten = List.Flatten(list=ui_multipleinputform_2.User_Inputs)
watch = Watch(flatten)
code_block_13 = CodeBlock(inputs=watch)
# ---------- code_block_13.designscript (11 lines) ----------
//family
inputs[0];

//line
inputs[1];

//NUMBER OF FAMILIES
inputs[2];

//ROTATE/OFFSET?
inputs[3];
# ----------------------------------------

watch_2 = Watch(code_block_13.out0)
elementType = Element.ElementType(element=watch_2)
watch_3 = Watch(code_block_13.out1)
geometry = Element.Geometry(element=watch_3)
code_block_14 = CodeBlock { "OFFSET DIAGLOG"; }
code_block_15 = CodeBlock { "REVERSE CURVE?"; FALSE; }  # unwired: FALSE
ui_boolean_input_2 = Custom[UI.Boolean input](InputName=code_block_15.out0)
code_block_16 = CodeBlock { "OFFSET FROM CURVE ENDS (INCHES)"; 0.0; 240; 12; 1; }
slider_2 = Custom[UI.Slider](InputName=code_block_16.out0, Minimum=code_block_16.out1, Maximum=code_block_16.out2, Default_Value=code_block_16.out3, Step=code_block_16.out4)
list_create_3 = List.Create(item0=ui_boolean_input_2, item1=slider_2)
ui_multipleinputform_3 = Custom[UI.MultipleInputForm ++](Description_optional=code_block_14, Inputs=list_create_3, Toggle=code_block_13.out3)
code_block_17 = CodeBlock(inputs=ui_multipleinputform_3.User_Inputs)
# ---------- code_block_17.designscript (5 lines) ----------
//OFFSET FROM CURVE ENDS
inputs[1];

//REVERSE CURVE?
inputs[0];
# ----------------------------------------
code_block_18 = CodeBlock(X=code_block_17.out0) { X; }

# group: convert offset to inch
watch_4 = Watch(geometry)
startPoint = Curve.StartPoint(curve=watch_4)
code_block_19 = CodeBlock { 0.01; }
pointAtParameter = Curve.PointAtParameter(curve=watch_4, param=code_block_19)
byStartPointEndPoint = Line.ByStartPointEndPoint(startPoint=startPoint, endPoint=pointAtParameter)
length = Curve.Length(curve=byStartPointEndPoint)
code_block_20 = CodeBlock(x=length) { x*100; }
convert_between_units = DynamoConvert(code_block_20, MeasurementType="Length", FromConversion="Feet", ToConversion="Inches")
flatten_2 = List.Flatten(list=convert_between_units)
code_block_21 = CodeBlock(x=code_block_18, y=flatten_2) { x/y; }
watch_5 = Watch(code_block_21)

# group: reverse / don't reverse
watch_6 = Watch(code_block_17.out1)
watch_7 = Watch(watch_5)
watch_8 = Watch(code_block_13.out2)
code_block_22 = CodeBlock(x=watch_7, amount=watch_8) { (0+x)..(1-x)..#amount; }
reverse = List.Reverse(list=code_block_22)
watch_9 = Watch(reverse)
watch_10 = Watch(code_block_22)
code_block_23 = CodeBlock(reverseList=watch_6, listReversed=watch_9, list=watch_10) { reverseList?listReversed:list; }

pointAtParameter_2 = Curve.PointAtParameter(curve=geometry, param=code_block_23@L1, lacing=Longest)
watch_11 = Watch(pointAtParameter_2)
byPoint = FamilyInstance.ByPoint(familyType=elementType, point=watch_11, lacing=CrossProduct)
watch_12 = Watch(geometry)
watch_13 = Watch(code_block_23)
tangentAtParameter = Curve.TangentAtParameter(curve=watch_12, param=watch_13)
XAxis = Vector.XAxis()
ZAxis = Vector.ZAxis()
angleAboutAxis = Vector.AngleAboutAxis(vector=tangentAtParameter, otherVector=XAxis, rotationAxis=ZAxis)
flatten_3 = List.Flatten(list=angleAboutAxis)
setRotation = FamilyInstance.SetRotation(familyInstance=byPoint, degree=flatten_3)
